# Dynamo graph Bounding box.dyn (Dynamo 3.3.0.6316)

python_script = Python()  # CPython3; unwired: IN[0]
# ---------- python_script.python (57 lines) ----------
import clr

import sys
sys.path.append('C:\Program Files (x86)\IronPython 2.7\Lib')

import System
from System.Collections.Generic import *

clr.AddReference('ProtoGeometry')
from Autodesk.DesignScript.Geometry import *

clr.AddReference("RevitNodes")
import Revit
clr.ImportExtensions(Revit.Elements)
clr.ImportExtensions(Revit.GeometryConversion)
clr.AddReference("RevitServices")
import RevitServices
from RevitServices.Persistence import DocumentManager 
from RevitServices.Transactions import TransactionManager 

clr.AddReference("RevitAPI")
clr.AddReference("RevitAPIUI")

import Autodesk 
from Autodesk.Revit.DB import *
from Autodesk.Revit.UI import *

doc = DocumentManager.Instance.CurrentDBDocument
uiapp = DocumentManager.Instance.CurrentUIApplication 
app = uiapp.Application 
uidoc = uiapp.ActiveUIDocument

def tolist(obj1):
	if isinstance(obj1,(list, tuple, set)): return obj1
	else: return [obj1]

#Preparing input from dynamo to revit
element = UnwrapElement(IN[0])

#Do some action in a Transaction

TransactionManager.Instance.EnsureInTransaction(doc)

level = FilteredElementCollector(doc).OfClass(Level).ToElements()

viewtyps = FilteredElementCollector(doc).OfClass(ViewFamilyType).ToElements()

threeDViewTyp = [i for i in viewtyps if i.LookupParameter("Type Name").AsString() == "3D View"][0]


#newview = View3D.CreateIsometric (doc, threeDViewTyp.Id)
#newview.Name = "Sundar"


TransactionManager.Instance.TransactionTaskDone()

OUT = threeDViewTyp
# ----------------------------------------
select_model_elements = DSModelElementsSelection()  # 3 picked in the model
python_script_2 = Python(IN[0]=select_model_elements)  # CPython3
# ---------- python_script_2.python (79 lines) ----------
import clr

import sys
sys.path.append('C:\Program Files (x86)\IronPython 2.7\Lib')

import System
from System.Collections.Generic import *

clr.AddReference('ProtoGeometry')
from Autodesk.DesignScript.Geometry import *

clr.AddReference("RevitNodes")
import Revit
clr.ImportExtensions(Revit.Elements)
clr.ImportExtensions(Revit.GeometryConversion)
clr.AddReference("RevitServices")
import RevitServices
from RevitServices.Persistence import DocumentManager 
from RevitServices.Transactions import TransactionManager 

clr.AddReference("RevitAPI")
clr.AddReference("RevitAPIUI")

import Autodesk 
from Autodesk.Revit.DB import *
from Autodesk.Revit.UI import *

doc = DocumentManager.Instance.CurrentDBDocument
uiapp = DocumentManager.Instance.CurrentUIApplication 
app = uiapp.Application 
uidoc = uiapp.ActiveUIDocument

def tolist(obj1):
	if isinstance(obj1,(list, tuple, set)): return obj1
	else: return [obj1]

#Preparing input from dynamo to revit
elements = tolist(UnwrapElement(IN[0]))

#Do some action in a Transaction

TransactionManager.Instance.EnsureInTransaction(doc)

cats = List[BuiltInCategory]()
cats.Add(BuiltInCategory.OST_CableTray)
cats.Add(BuiltInCategory.OST_DuctCurves)
cats.Add(BuiltInCategory.OST_PipeCurves)
cats.Add(BuiltInCategory.OST_Walls)

catFilter = ElementMulticategoryFilter(cats)

ovr = OverrideGraphicSettings()
ovr.SetProjectionLineColor(Color(255,0,0))

result = []

for element in elements:
    bb = element.get_BoundingBox(None)
    min = bb.Min
    max = bb.Max
    ot = Outline(min, max)
    bbFilter = BoundingBoxIntersectsFilter(ot)
    
    eleIds = List[ElementId]()
    eleIds.Add(element.Id)
    exclu = ExclusionFilter(eleIds)
    fec = FilteredElementCollector(doc).WherePasses(exclu).WherePasses(bbFilter).WherePasses(catFilter).ToElements()
    
    #for i in fec:
    #    doc.ActiveView.SetElementOverrides(i.Id, ovr)
    
    result.append([element,fec])




TransactionManager.Instance.TransactionTaskDone()

OUT = result
# ----------------------------------------
select_model_element = DSModelElementSelection()  # 1 picked in the model
ai_code = Python()  # CPython3; frozen; unwired: IN[0]
# ---------- ai_code.python (35 lines) ----------
import clr

clr.AddReference('RevitAPI')
from Autodesk.Revit.DB import *

clr.AddReference("RevitServices")
import RevitServices
from RevitServices.Persistence import DocumentManager
from RevitServices.Transactions import TransactionManager

doc = DocumentManager.Instance.CurrentDBDocument
view = doc.ActiveView

# Get all walls in the active view
walls = FilteredElementCollector(doc, view.Id).OfCategory(BuiltInCategory.OST_Walls).WhereElementIsNotElementType().ToElements()

# Define the color red (RGB 255, 0, 0)
color_red = Color(255, 0, 0)

TransactionManager.Instance.EnsureInTransaction(doc)

# Create OverrideGraphicSettings for projection lines
override_settings = OverrideGraphicSettings()
override_settings.SetProjectionLineColor(color_red)

# Create separate settings for surface if needed, or clear them if not wanted
# For this request, we only want to change the projection line color.
# If you also want to change the surface color to red, you would do:
# override_settings.SetSurfaceForegroundPatternColor(color_red)

for wall in walls:
    # Apply the override settings to the wall in the current view
    view.SetElementOverrides(wall.Id, override_settings)

TransactionManager.Instance.TransactionTaskDone()
# ----------------------------------------
