# Dynamo graph Document operations.dyn (Dynamo 3.3.0.6316)

select_model_element = DSModelElementSelection()  # 1 picked in the model
python_script = Python(IN[0]=select_model_element)  # CPython3
# ---------- python_script.python (97 lines) ----------
import clr

import sys
sys.path.append('C:\Program Files (x86)\IronPython 2.7\Lib')

import System
from System.Collections.Generic import *

clr.AddReference('ProtoGeometry')
from Autodesk.DesignScript.Geometry import *

clr.AddReference("RevitNodes")
import Revit
clr.ImportExtensions(Revit.Elements)
clr.ImportExtensions(Revit.GeometryConversion)
clr.AddReference("RevitServices")
import RevitServices
from RevitServices.Persistence import DocumentManager 
from RevitServices.Transactions import TransactionManager 

clr.AddReference("RevitAPI")
clr.AddReference("RevitAPIUI")

import Autodesk 
from Autodesk.Revit.DB import *
from Autodesk.Revit.UI import *

doc = DocumentManager.Instance.CurrentDBDocument
uiapp = DocumentManager.Instance.CurrentUIApplication 
app = uiapp.Application 
uidoc = uiapp.ActiveUIDocument

def tolist(obj1):
	if isinstance(obj1,(list, tuple, set)): return obj1
	else: return [obj1]

#Preparing input from dynamo to revit
element = UnwrapElement(IN[0])

#Do some action in a Transaction
"""
Rvtlinks = FilteredElementCollector(doc).OfClass(RevitLinkInstance).ToElements()
for Rvtlink in Rvtlinks:
    if "Architectural" in Rvtlink.Name:
        linkfile = Rvtlink
        break
        
linkDoc = linkfile.GetLinkDocument()
"""

path = r"C:\Users\Akryazz\OneDrive\Documents\My Files\Revit Api Training\Python Revit API Training\Revit Models\2025\MEP Model.rvt"

workSharedPath = r"C:\Users\Akryazz\OneDrive\Documents\My Files\Revit Api Training\Python Revit API Training\Revit Models\2025\Elec-Workshared.rvt"

modelPath = FilePath(workSharedPath)

opt = OpenOptions()
opt.Audit = False
opt.DetachFromCentralOption = DetachFromCentralOption.DoNotDetach

wsDoc = app.OpenDocumentFile(modelPath, opt) 

cts = FilteredElementCollector(wsDoc).OfCategory(BuiltInCategory.OST_CableTray).WhereElementIsNotElementType().ToElements()

TransactionManager.Instance.EnsureInTransaction(wsDoc)
for ct in cts:
    ct.LookupParameter("Comments").Set("Test my code")

TransactionManager.Instance.ForceCloseTransaction()

tOpt = TransactWithCentralOptions()
sOpt = SynchronizeWithCentralOptions()

wsDoc.SynchronizeWithCentral(tOpt, sOpt)
wsDoc.Close()


"""
mepDoc = app.OpenDocumentFile(path)

ducts = FilteredElementCollector(mepDoc).OfCategory(BuiltInCategory.OST_DuctCurves).WhereElementIsNotElementType().ToElements()



ductList = []
for duct in ducts:
    duct.LookupParameter("Comments").Set("21435213")
    comm = duct.LookupParameter("Comments").AsString()
    ductList.append(comm)


TransactionManager.Instance.ForceCloseTransaction()

mepDoc.Save()
mepDoc.Close()
"""
OUT = ct
# ----------------------------------------
