# Dynamo graph Export.dyn (Dynamo 3.3.0.6316)

python_script = Python()  # CPython3; unwired: IN[0]
# ---------- python_script.python (105 lines) ----------
import clr

import sys
sys.path.append('C:\Program Files (x86)\IronPython 2.7\Lib')

import System
from System.Collections.Generic import *

clr.AddReference('ProtoGeometry')
from Autodesk.DesignScript.Geometry import *

clr.AddReference("RevitNodes")
import Revit
clr.ImportExtensions(Revit.Elements)
clr.ImportExtensions(Revit.GeometryConversion)
clr.AddReference("RevitServices")
import RevitServices
from RevitServices.Persistence import DocumentManager 
from RevitServices.Transactions import TransactionManager 

clr.AddReference("RevitAPI")
clr.AddReference("RevitAPIUI")

import Autodesk 
from Autodesk.Revit.DB import *
from Autodesk.Revit.UI import *

import os
from pathlib import Path

doc = DocumentManager.Instance.CurrentDBDocument
uiapp = DocumentManager.Instance.CurrentUIApplication 
app = uiapp.Application 
uidoc = uiapp.ActiveUIDocument

def tolist(obj1):
	if isinstance(obj1,(list, tuple, set)): return obj1
	else: return [obj1]

#Preparing input from dynamo to revit
element = UnwrapElement(IN[0])

#Do some action in a Transaction

"""
public void Export(
    string folder,
    string name,
    NavisworksExportOptions options
)
"""
nwcOpt = NavisworksExportOptions()
nwcOpt.ConvertElementProperties = True
nwcOpt.ConvertLights = True
nwcOpt.ConvertLinkedCADFormats = False
nwcOpt.Coordinates = 0#NavisworksCoordinates.Internal
nwcOpt.DivideFileIntoLevels = False
nwcOpt.ExportElementIds = True
nwcOpt.ExportScope = NavisworksExportScope.View
#nwcOpt.ViewId = 

"""
public bool Export(
    string folder,
    string name,
    ICollection<ElementId> views,
    DWGExportOptions options
)"""


dwgOpt = DWGExportOptions()
dwgOpt.MergedViews = True

path = r"C:\Users\Akryazz\OneDrive\Documents\My Files\Revit Api Training\Python Revit API Training\Working Files\RevitApiTraining-March-2026\Exports"


sheet = FilteredElementCollector(doc).OfClass(ViewSheet).FirstElement()

#doc.Title+"_"+sheet.Name+".dwg"
fileName = f"{doc.Title}_{sheet.Name}.dwg"

sheetList = List[ElementId]()
sheetList.Add(sheet.Id)

from datetime import date

today = date.today()

folderPath = r"C:\Users\Akryazz\OneDrive\Documents\My Files\Revit Api Training\Python Revit API Training\Working Files\RevitApiTraining-March-2026\Exports\Ishaque-"+str(today)

Path(folderPath).mkdir(parents=True, exist_ok=True)

#doc.Export(folderPath, fileName, sheetList, dwgOpt)







TransactionManager.Instance.EnsureInTransaction(doc)

TransactionManager.Instance.TransactionTaskDone()

OUT = OptionalFunctionalityUtils.IsNavisworksExporterAvailable()
# ----------------------------------------
python_script_2 = Python()  # CPython3; unwired: IN[0]
# ---------- python_script_2.python (64 lines) ----------
import clr

import sys
sys.path.append('C:\Program Files (x86)\IronPython 2.7\Lib')

import System
from System.Collections.Generic import *

clr.AddReference('ProtoGeometry')
from Autodesk.DesignScript.Geometry import *

clr.AddReference("RevitNodes")
import Revit
clr.ImportExtensions(Revit.Elements)
clr.ImportExtensions(Revit.GeometryConversion)
clr.AddReference("RevitServices")
import RevitServices
from RevitServices.Persistence import DocumentManager 
from RevitServices.Transactions import TransactionManager 

clr.AddReference("RevitAPI")
clr.AddReference("RevitAPIUI")

import Autodesk 
from Autodesk.Revit.DB import *
from Autodesk.Revit.DB.Mechanical import *
from Autodesk.Revit.UI import *

doc = DocumentManager.Instance.CurrentDBDocument
uiapp = DocumentManager.Instance.CurrentUIApplication 
app = uiapp.Application 
uidoc = uiapp.ActiveUIDocument

def tolist(obj1):
	if isinstance(obj1,(list, tuple, set)): return obj1
	else: return [obj1]

revitelements = UnwrapElement(IN[0])

#Do some action in a Transaction


path = r"C:\Users\Akryazz\OneDrive\Documents\My Files\Revit Api Training\Python Revit API Training\Revit Models\2025\MEP Model.rvt"

mepdoc = app.OpenDocumentFile(path)

ducts = FilteredElementCollector(mepdoc).OfClass(Duct).ToElements()

TransactionManager.Instance.EnsureInTransaction(mepdoc)


ductlist = []
for duct in ducts:
    duct.LookupParameter("Comments").Set("Updated by Python")
    comm = duct.LookupParameter("Comments").AsString()
    ductlist.append(comm)

TransactionManager.Instance.ForceCloseTransaction()

mepdoc.Save()
mepdoc.Close()


OUT = element
# ----------------------------------------
