# Dynamo graph OpenC4RModel.dyn (Dynamo 3.3.0.6316)

get_project_and_model_guids = Python()  # CPython3; unwired: IN[0]
# ---------- get_project_and_model_guids.python (121 lines) ----------
# Dynamo CPython3 — Get ACC Project ID and Model (Item) ID
# ─────────────────────────────────────────────────────────
# Inputs (wire String nodes in Dynamo):
#   IN[0]  3-legged OAuth token
#   IN[1]  Hub name          e.g. "Akryaz"
#   IN[2]  Project name      e.g. "Construction : Sample Project - Seaport Civic Center"
#   IN[3]  File path in ACC  e.g. "Project Files/Models/CloudeModelTest.rvt"
#
# Outputs:
#   OUT[0]  Project ID
#   OUT[1]  Model (Item) ID

import json
import urllib.request
import urllib.parse
import urllib.error

from System import Guid

# IN is injected by Dynamo at runtime; fallback values let the script run standalone
_in = IN if "IN" in dir() else [  # type: ignore[name-defined]
    "your_3legged_token",
    "Akryaz",
    "Construction : Sample Project - Seaport Civic Center",
    "Project Files/Models/CloudeModelTest.rvt",
]
TOKEN        = "eyJhbGciOiJSUzI1NiIsImtpZCI6IlZiakZvUzhQU3lYODQyMV95dndvRUdRdFJEa19SUzI1NiIsInBpLmF0bSI6ImFzc2MifQ.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.TEFznAnG2CXChvmj45DgZ0mhhotWop5IiEBdVDbRcvIjlN_xQY2K8sPpITf4kdcj1a0SaemFY8aSGrl36__OxMN4akuI2p3tKY1HxQGap1Ly16ct9_Ko2Ga4DmC9Z73teI3sDb0uusm2_THzNPIaxpINc_HG9I1YgnSttlEPGeFoB5vwgV2-AXaSWzY2kugklQAoyz719JZ-2zYRbYccHa18jKGog9vxc0qF_Xm0t8rPHND1QePRGvnSvbNdJmQ77sB8e1dX5_ron0tzUooMZd1HvZWtGEVwuSmUyr7vYbR_G5u-d-swupdHt5RuQbW3DZ4v56gxFzkEMCIWcBZISQ"
HUB_NAME     = "Akryaz"
PROJECT_NAME = "Construction : Sample Project - Seaport Civic Center"
FILE_PATH    = "Project Files/Models/CloudeModelTest.rvt"

BASE_URL = "https://developer.api.autodesk.com"


# ── HTTP helper ────────────────────────────────────────────────────────────────
def api_get(endpoint, params=None):
    url = BASE_URL + endpoint
    if params:
        url += "?" + urllib.parse.urlencode(params)
    req = urllib.request.Request(url, headers={"Authorization": "Bearer " + TOKEN})
    with urllib.request.urlopen(req) as resp:
        return json.loads(resp.read().decode())["data"]


# ── Paginated folder contents ──────────────────────────────────────────────────
def get_folder_contents(project_id, folder_id):
    url    = "{}/data/v1/projects/{}/folders/{}/contents?page[limit]=200".format(
             BASE_URL, project_id, folder_id)
    items  = []
    while url:
        req = urllib.request.Request(url, headers={"Authorization": "Bearer " + TOKEN})
        with urllib.request.urlopen(req) as resp:
            body   = json.loads(resp.read().decode())
        items += body["data"]
        url    = body.get("links", {}).get("next", {}).get("href")
    return items


# ── Navigate folder tree ───────────────────────────────────────────────────────
def find_item(hub_id, project_id, file_path):
    parts       = file_path.strip("/").split("/")
    target_name = parts[-1]
    folder_path = parts[:-1]

    top_folders = api_get("/project/v1/hubs/{}/projects/{}/topFolders".format(hub_id, project_id))
    current     = next((f for f in top_folders if f["attributes"]["name"] == folder_path[0]), None)
    if not current:
        raise LookupError("Top-level folder not found: '{}'".format(folder_path[0]))

    for sub_name in folder_path[1:]:
        contents = get_folder_contents(project_id, current["id"])
        current  = next(
            (x for x in contents if x["type"] == "folders" and x["attributes"]["name"] == sub_name),
            None,
        )
        if not current:
            raise LookupError("Sub-folder not found: '{}'".format(sub_name))

    contents = get_folder_contents(project_id, current["id"])
    item     = next(
        (x for x in contents if x["type"] == "items" and x["attributes"]["displayName"] == target_name),
        None,
    )
    if not item:
        raise LookupError("File not found: '{}'".format(target_name))
    return item


# ── Main logic ─────────────────────────────────────────────────────────────────
try:
    # Find hub
    hubs   = api_get("/project/v1/hubs")
    hub    = next((h for h in hubs if h["attributes"]["name"] == HUB_NAME), None)
    if not hub:
        raise LookupError("Hub '{}' not found".format(HUB_NAME))
    hub_id = hub["id"]

    # Find project
    projects   = api_get("/project/v1/hubs/{}/projects".format(hub_id))
    project    = next((p for p in projects if p["attributes"]["name"] == PROJECT_NAME), None)
    if not project:
        raise LookupError("Project '{}' not found".format(PROJECT_NAME))
    project_id = project["id"]

    # Find file item
    item    = find_item(hub_id, project_id, FILE_PATH)
    item_id = item["id"]
    
    versions       = api_get("/data/v1/projects/{}/items/{}/versions".format(project_id, item_id))
    ext_data       = versions[0]["attributes"]["extension"]["data"]
    model_guid_str = ext_data["modelGuid"]
    proj_guid_str  = ext_data.get("projectGuid", project_id[2:])

    OUT = [Guid(proj_guid_str), Guid(model_guid_str)]

except urllib.error.HTTPError as e:
    OUT = ["HTTP Error {}: {}".format(e.code, e.reason), None]
except LookupError as e:
    OUT = [str(e), None]
except Exception as e:
    OUT = ["Error: " + str(e), None]
# ----------------------------------------
python_script = Python(IN[0]=get_project_and_model_guids)  # CPython3
# ---------- python_script.python (74 lines) ----------
import clr

import sys
sys.path.append('C:\Program Files (x86)\IronPython 2.7\Lib')

import System
from System.Collections.Generic import *

clr.AddReference('ProtoGeometry')
from Autodesk.DesignScript.Geometry import *

clr.AddReference("RevitNodes")
import Revit
clr.ImportExtensions(Revit.Elements)
clr.ImportExtensions(Revit.GeometryConversion)
clr.AddReference("RevitServices")
import RevitServices
from RevitServices.Persistence import DocumentManager 
from RevitServices.Transactions import TransactionManager 

clr.AddReference("RevitAPI")
clr.AddReference("RevitAPIUI")

import Autodesk 
from Autodesk.Revit.DB import *
from Autodesk.Revit.UI import *

doc = DocumentManager.Instance.CurrentDBDocument
uiapp = DocumentManager.Instance.CurrentUIApplication 
app = uiapp.Application 
uidoc = uiapp.ActiveUIDocument

def tolist(obj1):
	if isinstance(obj1,(list, tuple, set)): return obj1
	else: return [obj1]

#Preparing input from dynamo to revit
ids = UnwrapElement(IN[0])

projectId = ids[0]
modelId = ids[1]


path = ModelPathUtils.ConvertCloudGUIDsToCloudPath("US", projectId, modelId)

"""
public Document OpenDocumentFile(
    ModelPath modelPath,
    OpenOptions openOptions
)"""

opt = OpenOptions()
opt.Audit = False
opt.DetachFromCentralOption = DetachFromCentralOption.DoNotDetach


cloudDoc = app.OpenDocumentFile(path, opt)


floors = FilteredElementCollector(cloudDoc).OfClass(Floor).ToElements()

vals = []

for floor in floors:
    perimeter = floor.LookupParameter("Perimeter")
    paramValue = perimeter.AsDouble()*304.8
    vals.append(paramValue)


TransactionManager.Instance.EnsureInTransaction(doc)

TransactionManager.Instance.TransactionTaskDone()

OUT = vals
# ----------------------------------------
