# Dynamo graph Raytrace.dyn (Dynamo 3.3.0.6316)

sundar = Python()  # CPython3; frozen; unwired: IN[0]
# ---------- sundar.python (112 lines) ----------
import clr

import sys
sys.path.append('C:\Program Files (x86)\IronPython 2.7\Lib')

import System
from System.Collections.Generic import *

clr.AddReference('ProtoGeometry')
from Autodesk.DesignScript.Geometry import *

clr.AddReference("RevitNodes")
import Revit
clr.ImportExtensions(Revit.Elements)
clr.ImportExtensions(Revit.GeometryConversion)
clr.AddReference("RevitServices")
import RevitServices
from RevitServices.Persistence import DocumentManager 
from RevitServices.Transactions import TransactionManager 

clr.AddReference("RevitAPI")
clr.AddReference("RevitAPIUI")

import Autodesk 
from Autodesk.Revit.DB import *
from Autodesk.Revit.UI import *

doc = DocumentManager.Instance.CurrentDBDocument
uiapp = DocumentManager.Instance.CurrentUIApplication 
app = uiapp.Application 
uidoc = uiapp.ActiveUIDocument

def tolist(obj1):
	if isinstance(obj1,(list, tuple, set)): return obj1
	else: return [obj1]

#Preparing input from dynamo to revit
element = UnwrapElement(IN[0])

#Do some action in a Transaction
"""
TransactionManager.Instance.EnsureInTransaction(doc)

TaskDialog.Show("Prompt","Now select Revit Links only from the current view")

eles = uidoc.Selection.PickObjects(ObjectType.Element)
#selectrefs = uidoc.Selection.PickObjects(ObjectType.Element)
#ele = [doc.GetElement(i.ElementId) for i in selectrefs]
#lnkname = lnkele.Name


#ids = List[ElementId]()
lnkname = []
ductss = []
for lnkele in eles:
    linkInstance = doc.GetElement(lnkele)
    if isinstance(linkInstance, RevitLinkInstance):
        if linkInstance:
            linkdoc = linkInstance.GetLinkDocument()
            ducts = FilteredElementCollector(linkdoc).OfCategory(BuiltInCategory.OST_DuctCurves).WhereElementIsNotElementType().ToElements()
            ductss.append(ducts)
            #for duct in ducts:
                #id = duct.Id
                #ids.Add(id)
            lnknme = linkdoc.Title
            lnkname.append(lnknme)
    else:
        lnkname = "Selected element is not a Revit Link Instance"


#uidoc.Selection.SetElementIds(ids)

TransactionManager.Instance.TransactionTaskDone()

"""
views = FilteredElementCollector(doc).OfClass(View3D)

view = []
for v in views:
    if v.Name == "Sundar":
        viewn = v
        view.append(viewn)
        filename = v.Name+".nwc"
        break
"""
viewcls = List[ElementId]()
for vi in view:
    viewcls.Add(vi.Id)
"""
path = r"C:\Users\Asus\Downloads\DYNAMO TRAINING\LEVEL 02 - PYTHON\Export\NWC"

nwcOpt = NavisworksExportOptions()

nwcOpt.ExportLinks = True
nwcOpt.ExportRoomAsAttribute = True
nwcOpt.ExportRoomGeometry = True
nwcOpt.ConvertElementProperties = True
nwcOpt.ConvertLights = True
nwcOpt.ConvertLinkedCADFormats = False
nwcOpt.DivideFileIntoLevels = False
nwcOpt.Coordinates = 0#NavisworksCoordinates.Internal
nwcOpt.ExportElementIds = True
nwcOpt.ExportScope = NavisworksExportScope.View
nwcOpt.ViewId = doc.ActiveView.Id


#doc.Export(path, "Test.nwc", nwcOpt)

#OUT = "Exported sucessfully" if result else "Not Exported"


OUT = nwcOpt
# ----------------------------------------
python_script = Python()  # CPython3; frozen; unwired: IN[0]
# ---------- python_script.python (82 lines) ----------
import clr

import sys
sys.path.append('C:\Program Files (x86)\IronPython 2.7\Lib')

import System
from System.Collections.Generic import *

clr.AddReference('ProtoGeometry')
from Autodesk.DesignScript.Geometry import *

clr.AddReference("RevitNodes")
import Revit
clr.ImportExtensions(Revit.Elements)
clr.ImportExtensions(Revit.GeometryConversion)
clr.AddReference("RevitServices")
import RevitServices
from RevitServices.Persistence import DocumentManager 
from RevitServices.Transactions import TransactionManager 

clr.AddReference("RevitAPI")
clr.AddReference("RevitAPIUI")

import Autodesk 
from Autodesk.Revit.DB import *
from Autodesk.Revit.UI import *

doc = DocumentManager.Instance.CurrentDBDocument
uiapp = DocumentManager.Instance.CurrentUIApplication 
app = uiapp.Application 
uidoc = uiapp.ActiveUIDocument

def tolist(obj1):
	if isinstance(obj1,(list, tuple, set)): return obj1
	else: return [obj1]

#Preparing input from dynamo to revit
element = UnwrapElement(IN[0])

# Opening external document and saving as dwg

extPath = r"F:\BIM ERA_AUTOMATION\Level-2_Revit Api and Python\Test file.rvt"


# Collecting first sheet from the CURRENT document

sheet = FilteredElementCollector(doc)\
            .OfClass(ViewSheet)\
            .FirstElement()


fileName = "Test file.dwg"

# Date

from datetime import date
from pathlib import Path

today      = date.today()
folderPath = r"F:\BIM ERA_AUTOMATION\Level-2_Revit Api and Python\Test file"
Path(folderPath).mkdir(parents=True, exist_ok=True)

# DWG export 

dwgOpt = DWGExportOptions()            

# Sheet list 

sheetList = List[ElementId]()
sheetList.Add(sheet.Id)

#doc.Export(folderPath, fileName, sheetList, dwgOpt)


TransactionManager.Instance.EnsureInTransaction(doc) 


TransactionManager.Instance.TransactionTaskDone()

# True = Exported, False = Not Exported

OUT = range(100,501,100)
# ----------------------------------------
dnyan = Python()  # CPython3; frozen; unwired: IN[0]
# ---------- dnyan.python (111 lines) ----------
import clr

import sys
sys.path.append('C:\Program Files (x86)\IronPython 2.7\Lib')

import System
from System.Collections.Generic import *

clr.AddReference('ProtoGeometry')
from Autodesk.DesignScript.Geometry import *

clr.AddReference("RevitNodes")
import Revit
clr.ImportExtensions(Revit.Elements)
clr.ImportExtensions(Revit.GeometryConversion)
clr.AddReference("RevitServices")
import RevitServices
from RevitServices.Persistence import DocumentManager 
from RevitServices.Transactions import TransactionManager 

clr.AddReference("RevitAPI")
clr.AddReference("RevitAPIUI")

import Autodesk 
from Autodesk.Revit.DB import *
from Autodesk.Revit.UI import *

doc = DocumentManager.Instance.CurrentDBDocument
uiapp = DocumentManager.Instance.CurrentUIApplication 
app = uiapp.Application 
uidoc = uiapp.ActiveUIDocument

def tolist(obj1):
	if isinstance(obj1,(list, tuple, set)): return obj1
	else: return [obj1]

#Preparing input from dynamo to revit
element = UnwrapElement(IN[0])

#Do some action in a Transaction

TransactionManager.Instance.EnsureInTransaction(doc)

TransactionManager.Instance.TransactionTaskDone()


author = "Dnyan"

# input from Dynamo
input_elements = FilteredElementCollector(doc).OfClass(RevitLinkInstance).ToElements()

# Output List
element_names    = []
element_ids      = []
element_cats     = []
linked_doc_names = []


for elem in input_elements:
    try:
        unwrapped = UnwrapElement(elem)

        if unwrapped is None:
            continue

# Link Instance 
        if isinstance(unwrapped, RevitLinkInstance):

            linked_doc = unwrapped.GetLinkDocument()
            if linked_doc is None:
                continue

        # Collect all elements from linked doc
            elements = FilteredElementCollector(linked_doc)\
                        .WhereElementIsNotElementType()\
                        .ToElements()

            for linked_element in elements:
                try:
                    type_id   = linked_element.GetTypeId()
                    elem_type = linked_doc.GetElement(type_id)
                    name = elem_type.Name if elem_type else linked_element.Name
                except:
                    name = linked_element.Name if hasattr(linked_element, 'Name') else "Unnamed"

                cat = linked_element.Category.Name if linked_element.Category else "No Category"

                element_names.append(name)
                element_ids.append(linked_element.Id.IntegerValue)
                element_cats.append(cat)
                linked_doc_names.append(linked_doc.Title)
        else:
            try:
                type_id   = unwrapped.GetTypeId()
                elem_type = doc.GetElement(type_id)
                name = elem_type.Name if elem_type else unwrapped.Name
            except:
                name = unwrapped.Name if hasattr(unwrapped, 'Name') else "Unnamed"

            cat = unwrapped.Category.Name if unwrapped.Category else "No Category"

            element_names.append(name)
            element_ids.append(unwrapped.Id.IntegerValue)
            element_cats.append(cat)
            linked_doc_names.append(doc.Title)

    except:
        pass

# Output
OUT = element_names, element_ids, element_cats, linked_doc_names, author
# ----------------------------------------
sort_elements_by_name = Python()  # CPython3; frozen; unwired: IN[0]
# ---------- sort_elements_by_name.python (68 lines) ----------
import clr

import sys
sys.path.append('C:\Program Files (x86)\IronPython 2.7\Lib')

import System
from System.Collections.Generic import *

clr.AddReference('ProtoGeometry')
from Autodesk.DesignScript.Geometry import *

clr.AddReference("RevitNodes")
import Revit
clr.ImportExtensions(Revit.Elements)
clr.ImportExtensions(Revit.GeometryConversion)
clr.AddReference("RevitServices")
import RevitServices
from RevitServices.Persistence import DocumentManager 
from RevitServices.Transactions import TransactionManager 

clr.AddReference("RevitAPI")
clr.AddReference("RevitAPIUI")

import Autodesk 
from Autodesk.Revit.DB import *
from Autodesk.Revit.UI import *

doc = DocumentManager.Instance.CurrentDBDocument
uiapp = DocumentManager.Instance.CurrentUIApplication 
app = uiapp.Application 
uidoc = uiapp.ActiveUIDocument

def tolist(obj1):
	if isinstance(obj1,(list, tuple, set)): return obj1
	else: return [obj1]

#Preparing input from dynamo to revit
element = UnwrapElement(IN[0])

#Do some action in a Transaction

elements = FilteredElementCollector(doc).OfClass(Wall)\
    .WhereElementIsNotElementType()\
    .ToElements()

# Store (name, element) pairs
element_data = []

for ele in elements:
    try:
        name = ele.Name
    except:
        name = "Unnamed Element"

    element_data.append((name, ele))

# Sort by name
sorted_data = sorted(element_data, key=lambda x: x[0])

# Separate sorted names and elements
sorted_names = [x[0] for x in sorted_data]
sorted_elements = [x[1] for x in sorted_data]
TransactionManager.Instance.EnsureInTransaction(doc)

TransactionManager.Instance.TransactionTaskDone()


OUT = sorted_elements, sorted_names
# ----------------------------------------
select_model_element = DSModelElementSelection()  # 1 picked in the model
python_script_2 = Python(IN[0]=select_model_element)  # CPython3; unwired: IN[1]
# ---------- python_script_2.python (119 lines) ----------
import clr

import sys
sys.path.append('C:\Program Files (x86)\IronPython 2.7\Lib')

import System
from System.Collections.Generic import *

clr.AddReference('ProtoGeometry')
from Autodesk.DesignScript.Geometry import *

clr.AddReference("RevitNodes")
import Revit
clr.ImportExtensions(Revit.Elements)
clr.ImportExtensions(Revit.GeometryConversion)
clr.AddReference("RevitServices")
import RevitServices
from RevitServices.Persistence import DocumentManager 
from RevitServices.Transactions import TransactionManager 

clr.AddReference("RevitAPI")
clr.AddReference("RevitAPIUI")

import Autodesk 
from Autodesk.Revit.DB import *
from Autodesk.Revit.UI import *

doc = DocumentManager.Instance.CurrentDBDocument
uiapp = DocumentManager.Instance.CurrentUIApplication 
app = uiapp.Application 
uidoc = uiapp.ActiveUIDocument

def tolist(obj1):
	if isinstance(obj1,(list, tuple, set)): return obj1
	else: return [obj1]

#Preparing input from dynamo to revit
dl = UnwrapElement(IN[0])
dl1 = UnwrapElement(IN[1])

#Do some action in a Transaction
"""
public ReferenceIntersector(
    ElementFilter filter,
    FindReferenceTarget targetType,
    View3D view3d
)

public ReferenceWithContext FindNearest(
    XYZ origin,
    XYZ direction
)"""


view3Ds = FilteredElementCollector(doc).OfClass(View3D).ToElements()
sundarView = [i for i in view3Ds if i.Name == "Sundar"][0]

catFilter = ElementCategoryFilter(BuiltInCategory.OST_Walls)

ri = ReferenceIntersector(catFilter, FindReferenceTarget.Element, sundarView)

loc = dl.Location.Curve
origin = loc.Origin

newOrgin = XYZ(origin.X, origin.Y, origin.Z+(6000/304.8))


sp = loc.GetEndPoint(0)
ep = loc.GetEndPoint(1)

diff = ep.Subtract(sp).Normalize()

vec = XYZ(0.0000001,0,0)



rwc = ri.FindNearest(loc.Origin, loc.Direction)
refer = rwc.GetReference()
ele = doc.GetElement(refer)
dist = rwc.Proximity*304.8
pt = refer.GlobalPoint.ToPoint()


eleList = []
distList = []
ptList = []

rwcs = ri.Find(newOrgin, vec)
for rwc in rwcs:
    refer = rwc.GetReference()
    ele = doc.GetElement(refer)
    eleList.append(ele)
    
    dist = round(rwc.Proximity*304.8)
    distList.append(dist)
    
    pt = refer.GlobalPoint.ToPoint()
    ptList.append(pt)
    
    














TransactionManager.Instance.EnsureInTransaction(doc)

TransactionManager.Instance.TransactionTaskDone()

OUT = eleList, distList, ptList
# ----------------------------------------
select_model_element_2 = DSModelElementSelection()  # 1 picked in the model
python_script_3 = Python(IN[0]=select_model_element_2)  # CPython3
# ---------- python_script_3.python (89 lines) ----------
import clr

import sys
sys.path.append('C:\Program Files (x86)\IronPython 2.7\Lib')

import System
from System.Collections.Generic import *

clr.AddReference('ProtoGeometry')
from Autodesk.DesignScript.Geometry import *

clr.AddReference("RevitNodes")
import Revit
clr.ImportExtensions(Revit.Elements)
clr.ImportExtensions(Revit.GeometryConversion)
clr.AddReference("RevitServices")
import RevitServices
from RevitServices.Persistence import DocumentManager 
from RevitServices.Transactions import TransactionManager 

clr.AddReference("RevitAPI")
clr.AddReference("RevitAPIUI")

import Autodesk 
from Autodesk.Revit.DB import *
from Autodesk.Revit.DB.Structure import *
from Autodesk.Revit.UI import *

doc = DocumentManager.Instance.CurrentDBDocument
uiapp = DocumentManager.Instance.CurrentUIApplication 
app = uiapp.Application 
uidoc = uiapp.ActiveUIDocument

def tolist(obj1):
	if isinstance(obj1,(list, tuple, set)): return obj1
	else: return [obj1]

#Preparing input from dynamo to revit
dl = UnwrapElement(IN[0])

#Do some action in a Transaction

view3Ds = FilteredElementCollector(doc).OfClass(View3D).ToElements()
sundarView = [i for i in view3Ds if i.Name == "Sundar"][0]

catFilter = ElementCategoryFilter(BuiltInCategory.OST_Ceilings)

ri = ReferenceIntersector(catFilter, FindReferenceTarget.Element, sundarView)

loc = dl.Location.Curve
origin = loc.Center

dir = XYZ(0,0,1)

rwc = ri.FindNearest(origin, dir)
refer = rwc.GetReference()
ele = doc.GetElement(refer)
dist = rwc.Proximity*304.8
pt = refer.GlobalPoint


"""
public FamilyInstance NewFamilyInstance(
    XYZ location,
    FamilySymbol symbol,
    Element host,
    Level level,
    StructuralType structuralType
)"""


fs = FilteredElementCollector(doc).OfCategory(BuiltInCategory.OST_LightingFixtures).WhereElementIsElementType().FirstElement()

level = doc.GetElement(ele.LevelId)






TransactionManager.Instance.EnsureInTransaction(doc)


newFixture = doc.Create.NewFamilyInstance(pt, fs, ele, level, StructuralType.NonStructural)


TransactionManager.Instance.TransactionTaskDone()

OUT = newFixture
# ----------------------------------------
