# Dynamo graph SOlid filter.dyn (Dynamo 3.3.0.6316)

select_model_elements = DSModelElementsSelection()  # 4 picked in the model
python_script = Python(IN[0]=select_model_elements)  # CPython3
# ---------- python_script.python (99 lines) ----------
import clr

import sys
sys.path.append('C:\Program Files (x86)\IronPython 2.7\Lib')

import System
from System.Collections.Generic import *

clr.AddReference('ProtoGeometry')
from Autodesk.DesignScript.Geometry import *

clr.AddReference("RevitNodes")
import Revit
clr.ImportExtensions(Revit.Elements)
clr.ImportExtensions(Revit.GeometryConversion)
clr.AddReference("RevitServices")
import RevitServices
from RevitServices.Persistence import DocumentManager 
from RevitServices.Transactions import TransactionManager 

clr.AddReference("RevitAPI")
clr.AddReference("RevitAPIUI")

import Autodesk 
from Autodesk.Revit.DB import *
from Autodesk.Revit.DB.Mechanical import *
from Autodesk.Revit.UI import *

doc = DocumentManager.Instance.CurrentDBDocument
uiapp = DocumentManager.Instance.CurrentUIApplication 
app = uiapp.Application 
uidoc = uiapp.ActiveUIDocument

def tolist(obj1):
	if isinstance(obj1,(list, tuple, set)): return obj1
	else: return [obj1]

#Preparing input from dynamo to revit
walls = tolist(UnwrapElement(IN[0]))

#Do some action in a Transaction

TransactionManager.Instance.EnsureInTransaction(doc)

rvtLinks = FilteredElementCollector(doc).OfClass(RevitLinkInstance).ToElements()

for rvtLink in rvtLinks:
    if "MEP Model" in rvtLink.Name:
        linkFile = rvtLink
        break

linkDoc = linkFile.GetLinkDocument()

linkDucts = FilteredElementCollector(linkDoc).OfClass(Duct).ToElements()

paramValues = []

for linkDuct in linkDucts:
    commentParam = linkDuct.LookupParameter("Comments")
    value = commentParam.AsString()
    #commentParam.Set("Test")
    paramValues.append(value)   
    

results = []

vfts = FilteredElementCollector(doc).OfClass(ViewFamilyType).ToElements()

for vft in vfts:
    if vft.LookupParameter("Type Name").AsString() == "3D View":
        threeDType = vft
        break


for wall in walls:
    bb = wall.get_BoundingBox(None)
    bbFilter = BoundingBoxIntersectsFilter(Outline(bb.Min, bb.Max))
    geos = wall.get_Geometry(Options())
    solid = list(geos)[0]
    solidFilter = ElementIntersectsSolidFilter(solid)
    clashes = FilteredElementCollector(linkDoc).OfClass(Duct).WherePasses(bbFilter).WherePasses(solidFilter).ToElements()
    
    coll = List[ElementId]()
    coll.Add(linkFile.Id)
    coll.Add(wall.Id)

    newView = View3D.CreateIsometric(doc, threeDType.Id)
    newView.Name = str(wall.Id.Value)
    newView.SetSectionBox(bb)
    
    newView.IsolateElementsTemporary(coll)
    
    results.append([wall, clashes])



TransactionManager.Instance.TransactionTaskDone()

OUT = threeDType
# ----------------------------------------
select_model_element = DSModelElementSelection()  # 1 picked in the model
