# Dynamo graph UI.dyn (Dynamo 3.3.0.6316)

python_script = Python()  # CPython3; frozen; unwired: IN[0]
# ---------- python_script.python (52 lines) ----------
import clr

import sys
sys.path.append('C:\Program Files (x86)\IronPython 2.7\Lib')

import System
from System.Collections.Generic import *

clr.AddReference('ProtoGeometry')
from Autodesk.DesignScript.Geometry import *

clr.AddReference("RevitNodes")
import Revit
clr.ImportExtensions(Revit.Elements)
clr.ImportExtensions(Revit.GeometryConversion)

clr.AddReference("RevitServices")
import RevitServices
from RevitServices.Persistence import DocumentManager 
from RevitServices.Transactions import TransactionManager 

clr.AddReference("RevitAPI")
clr.AddReference("RevitAPIUI")

clr.AddReference('System.Windows.Forms')
clr.AddReference('PresentationCore')
clr.AddReference ('AdWindows')


import Autodesk.Windows as adwin
from System.Windows.Media import RotateTransform

import Autodesk 
from Autodesk.Revit.DB import *
from Autodesk.Revit.UI import *

doc = DocumentManager.Instance.CurrentDBDocument
uiapp = DocumentManager.Instance.CurrentUIApplication 
app = uiapp.Application 
uidoc = uiapp.ActiveUIDocument


def tilt_ribbon (angle):
    ribbon = adwin. ComponentManager.Ribbon 
    ribbon.RenderTransform = RotateTransform(angle)
    return ribbon


TransactionManager.Instance. EnsureInTransaction(doc)
TransactionManager.Instance.TransactionTaskDone()

OUT = tilt_ribbon(0)
# ----------------------------------------
winform_demo = Python()  # CPython3; frozen; unwired: IN[0]
# ---------- winform_demo.python (87 lines) ----------
import clr

# .NET references
clr.AddReference('System.Windows.Forms')
clr.AddReference('System.Drawing')

from System.Windows.Forms import Form, Label, TextBox, NumericUpDown, TrackBar, CheckBox, Button, DialogResult
from System.Drawing import Point, Size
from System import Decimal

class SimpleForm(Form):
    def __init__(self):
        self.Text = "User Input Form"
        self.Size = Size(800, 800)

        # Name
        self.labelName = Label()
        self.labelName.Text = "Name:"
        self.labelName.Location = Point(100, 20)

        self.textName = TextBox()
        self.textName.Location = Point(500, 20)
        self.textName.Width = 150

        # Age (NumericUpDown requires Decimal)
        self.labelAge = Label()
        self.labelAge.Text = "Age:"
        self.labelAge.Location = Point(10, 60)

        self.numAge = NumericUpDown()
        self.numAge.Location = Point(120, 60)
        self.numAge.Width = 60
        self.numAge.Minimum = Decimal(0)
        self.numAge.Maximum = Decimal(120)
        self.numAge.Value = Decimal(25)

        # Experience (Slider)
        self.labelExp = Label()
        self.labelExp.Text = "Experience:"
        self.labelExp.Location = Point(10, 100)

        self.sliderExp = TrackBar()
        self.sliderExp.Location = Point(120, 90)
        self.sliderExp.Width = 150
        self.sliderExp.Minimum = 0
        self.sliderExp.Maximum = 40
        self.sliderExp.TickFrequency = 5
        self.sliderExp.Value = 5

        # Married checkbox
        self.checkMarried = CheckBox()
        self.checkMarried.Text = "Married"
        self.checkMarried.Location = Point(120, 140)

        # Submit Button
        self.buttonSubmit = Button()
        self.buttonSubmit.Text = "Submit"
        self.buttonSubmit.Location = Point(100, 200)
        self.buttonSubmit.Click += self.on_submit

        # Add controls
        self.Controls.Add(self.labelName)
        self.Controls.Add(self.textName)
        self.Controls.Add(self.labelAge)
        self.Controls.Add(self.numAge)
        self.Controls.Add(self.labelExp)
        self.Controls.Add(self.sliderExp)
        self.Controls.Add(self.checkMarried)
        self.Controls.Add(self.buttonSubmit)

        self.result = None

    def on_submit(self, sender, args):
        self.result = {
            "Name": self.textName.Text,
            "Age": int(self.numAge.Value),  # convert Decimal → int safely
            "Experience": self.sliderExp.Value,
            "Married": self.checkMarried.Checked
        }
        self.DialogResult = DialogResult.OK
        self.Close()

# Run form (modal)
form = SimpleForm()
form.ShowDialog()

OUT = form.result
# ----------------------------------------
shaik_code = Python()  # CPython3; frozen; unwired: IN[0]
# ---------- shaik_code.python (69 lines) ----------
import clr

import sys
sys.path.append('C:\Program Files (x86)\IronPython 2.7\Lib')

import System
from System.Collections.Generic import *

clr.AddReference('ProtoGeometry')
from Autodesk.DesignScript.Geometry import *

clr.AddReference("RevitNodes")
import Revit
clr.ImportExtensions(Revit.Elements)
clr.ImportExtensions(Revit.GeometryConversion)
clr.AddReference("RevitServices")
import RevitServices
from RevitServices.Persistence import DocumentManager 
from RevitServices.Transactions import TransactionManager 

clr.AddReference("RevitAPI")
clr.AddReference("RevitAPIUI")

import Autodesk 
from Autodesk.Revit.DB import *
from Autodesk.Revit.UI import *

doc = DocumentManager.Instance.CurrentDBDocument
uiapp = DocumentManager.Instance.CurrentUIApplication 
app = uiapp.Application 
uidoc = uiapp.ActiveUIDocument

def tolist(obj1):
	if isinstance(obj1,(list, tuple, set)): return obj1
	else: return [obj1]

#Preparing input from dynamo to revit
element = UnwrapElement(IN[0])

#path1 = "D:\revit-practice-trails\automation\Project1.rvt"
#path2 = "D:\revit-practice-trails\automation\Project2.rvt"
#path3 = "D:\revit-practice-trails\automation\Project3.rvt"
doc1 = r"D:\revit-practice-trails\automation\Project1.rvt"
doc2 = r"D:\revit-practice-trails\automation\Project2.rvt"
doc3 = r"D:\revit-practice-trails\automation\Project3.rvt"
docNames = [doc1, doc2, doc3]

dwgOpts = DWGExportOptions()
dwgOpts.FileVersion=ACADVersion.R2018
dwgOpts.MergedViews= False

for docName in docNames:
    edoc = app.OpenDocumentFile(docName)

    sheet = FilteredElementCollector(edoc).OfClass(ViewSheet).FirstElement()
    
    sheetList = List[ElementId]()
    sheetList.Add(sheet.Id)
    
    filename = f"{edoc.Title}_{sheet.Name}.dwg"
    
    folderpath =r"D:\revit-practice-trails\automation\exports"
    
    #doc.Export(folderpath, filename, sheetList, dwgOpts)
    edoc.Close()
TransactionManager.Instance.EnsureInTransaction(doc)
TransactionManager.Instance.TransactionTaskDone()

OUT = element
# ----------------------------------------
python_script_2 = Python()  # CPython3; unwired: IN[0]
# ---------- python_script_2.python (52 lines) ----------
import clr

import sys
sys.path.append('C:\Program Files (x86)\IronPython 2.7\Lib')

import System
from System.Collections.Generic import *

clr.AddReference('ProtoGeometry')
from Autodesk.DesignScript.Geometry import *

clr.AddReference("RevitNodes")
import Revit
clr.ImportExtensions(Revit.Elements)
clr.ImportExtensions(Revit.GeometryConversion)
clr.AddReference("RevitServices")
import RevitServices
from RevitServices.Persistence import DocumentManager 
from RevitServices.Transactions import TransactionManager 

clr.AddReference("RevitAPI")
clr.AddReference("RevitAPIUI")

import Autodesk 
from Autodesk.Revit.DB import *
from Autodesk.Revit.UI import TaskDialog

doc = DocumentManager.Instance.CurrentDBDocument
uiapp = DocumentManager.Instance.CurrentUIApplication 
app = uiapp.Application 
uidoc = uiapp.ActiveUIDocument

def tolist(obj1):
	if isinstance(obj1,(list, tuple, set)): return obj1
	else: return [obj1]

#Preparing input from dynamo to revit
element = UnwrapElement(IN[0])

#Do some action in a Transaction


walls = FilteredElementCollector(doc).OfClass(Wall).ToElements()

#TaskDialog.Show("Welcome", "No. of walls = "+str(len(walls)))


TransactionManager.Instance.EnsureInTransaction(doc)

TransactionManager.Instance.TransactionTaskDone()

OUT = element
# ----------------------------------------
python_script_3 = Python()  # CPython3; unwired: IN[0]
# ---------- python_script_3.python (139 lines) ----------
import clr

import sys
sys.path.append('C:\Program Files (x86)\IronPython 2.7\Lib')

import System
from System.Collections.Generic import *

clr.AddReference('ProtoGeometry')
from Autodesk.DesignScript.Geometry import *

clr.AddReference("RevitNodes")
import Revit
clr.ImportExtensions(Revit.Elements)
clr.ImportExtensions(Revit.GeometryConversion)
clr.AddReference("RevitServices")
import RevitServices
from RevitServices.Persistence import DocumentManager 
from RevitServices.Transactions import TransactionManager 

clr.AddReference("RevitAPI")
clr.AddReference("RevitAPIUI")

import Autodesk 
from Autodesk.Revit.DB import *
from Autodesk.Revit.UI import *
from Autodesk.Revit.UI.Selection import *

doc = DocumentManager.Instance.CurrentDBDocument
uiapp = DocumentManager.Instance.CurrentUIApplication 
app = uiapp.Application 
uidoc = uiapp.ActiveUIDocument

def tolist(obj1):
	if isinstance(obj1,(list, tuple, set)): return obj1
	else: return [obj1]

#Preparing input from dynamo to revit
element = UnwrapElement(IN[0])

#Do some action in a Transaction

selectedIds = uidoc.Selection.GetElementIds()

"""
result = []

for selectedId in selectedIds:
    ele = doc.GetElement(selectedId)
    result.append(ele.Name)
"""






















"""public void SetElementIds(
    ICollection<ElementId> elementIds
)"""


walls = FilteredElementCollector(doc).OfClass(Wall).ToElements()

ids = List[ElementId]()

for wall in walls:
    id = wall.Id
    ids.Add(id)
    

#uidoc.Selection.SetElementIds(ids)

"""
TaskDialog.Show("Prompt", "Now select elements in Revit screen")
slectedIds = uidoc.Selection.PickElementsByRectangle("Pick Elements - User Hint")
TaskDialog.Show("Prompt", "Selection over")
"""

"""
selectedRefs = uidoc.Selection.PickObjects(ObjectType.Element)
eles = []
for i in selectedRefs:
    ele = doc.GetElement(i.ElementId)
    eles.append(ele)
    

#eles = [doc.GetElement(i.ElementId) for i in eles]

"""

#linkiedEle = uidoc.Selection.PickObject(ObjectType.LinkedElement)


class CustomFilter(ISelectionFilter):
    def __init__(self):
        super(CustomFilter, self).__init__()

    def AllowElement(self, element):
        try:
            return element.Category.Name == "Walls"
        except:
            return False

    def AllowReference(self, reference, point):
        return False

#filt = CustomFilter()



#selectedElements = uidoc.Selection.PickElementsByRectangle(filt)






TransactionManager.Instance.EnsureInTransaction(doc)

TransactionManager.Instance.TransactionTaskDone()

OUT = selectedElements
# ----------------------------------------
select_model_element = DSModelElementSelection()  # 1 picked in the model
wall_types = WallTypes("Concrete Wall")
python_script_4 = Python(IN[0]=select_model_element, IN[1]=wall_types)  # CPython3
# ---------- python_script_4.python (50 lines) ----------
import clr

import sys
sys.path.append('C:\Program Files (x86)\IronPython 2.7\Lib')

import System
from System.Collections.Generic import *

clr.AddReference('ProtoGeometry')
from Autodesk.DesignScript.Geometry import *

clr.AddReference("RevitNodes")
import Revit
clr.ImportExtensions(Revit.Elements)
clr.ImportExtensions(Revit.GeometryConversion)
clr.AddReference("RevitServices")
import RevitServices
from RevitServices.Persistence import DocumentManager 
from RevitServices.Transactions import TransactionManager 

clr.AddReference("RevitAPI")
clr.AddReference("RevitAPIUI")

import Autodesk 
from Autodesk.Revit.DB import *
from Autodesk.Revit.UI import *

doc = DocumentManager.Instance.CurrentDBDocument
uiapp = DocumentManager.Instance.CurrentUIApplication 
app = uiapp.Application 
uidoc = uiapp.ActiveUIDocument

def tolist(obj1):
	if isinstance(obj1,(list, tuple, set)): return obj1
	else: return [obj1]

#Preparing input from dynamo to revit
wall = UnwrapElement(IN[0])
newType = UnwrapElement(IN[1])

#Do some action in a Transaction

TransactionManager.Instance.EnsureInTransaction(doc)

#wall.WallType = newType


TransactionManager.Instance.TransactionTaskDone()

OUT = wall
# ----------------------------------------
