# Dynamo graph c#.dyn (Dynamo 3.3.0.6316)

subash_code = Python()  # CPython3; unwired: IN[0]
# ---------- subash_code.python (94 lines) ----------
import clr

# Revit API
clr.AddReference('RevitAPI')
clr.AddReference('RevitServices')

from Autodesk.Revit.DB import *
from RevitServices.Persistence import DocumentManager
from RevitServices.Transactions import TransactionManager

# Document
doc = DocumentManager.Instance.CurrentDBDocument

# Inputs from Dynamo
elements = UnwrapElement(IN[0])
view = UnwrapElement(IN[1])

# -----------------------------
# CHANGE THIS BASED ON ELEMENT
# -----------------------------
tagCategory = BuiltInCategory.OST_WallTags   # Change if needed

# -----------------------------
# GET TAG FAMILY TYPE
# -----------------------------
tagSymbols = FilteredElementCollector(doc)\
    .OfClass(FamilySymbol)\
    .OfCategory(tagCategory)\
    .ToElements()
    

if not tagSymbols:
    OUT = "❌ No tag family loaded for this category"
else:
    tagType = tagSymbols[0]

    # Activate tag type if needed
    if not tagType.IsActive:
        TransactionManager.Instance.EnsureInTransaction(doc)
        tagType.Activate()
        TransactionManager.Instance.TransactionTaskDone()

    # -----------------------------
    # CREATE TAGS
    # -----------------------------
    TransactionManager.Instance.EnsureInTransaction(doc)

    count = 0
    failed = 0

    for elem in elements:
        try:
            if elem is None:
                continue

            loc = elem.Location

            # Get placement point
            if isinstance(loc, LocationCurve):
                point = loc.Curve.Evaluate(0.5, True)
            elif isinstance(loc, LocationPoint):
                point = loc.Point
            else:
                failed += 1
                continue

            # Create reference
            refer = Reference(elem)
            if refer is None:
                failed += 1
                continue

            # Create tag
            tag = IndependentTag.Create(
                doc,
                tagType.Id,   # IMPORTANT FIX
                view.Id,
                refer,
                False,
                TagOrientation.Horizontal,
                point
            )

            if tag:
                count += 1
            else:
                failed += 1

        except:
            failed += 1

    TransactionManager.Instance.TransactionTaskDone()

    OUT = "✅ Tags created: {} | ❌ Failed: {}".format(count, failed)"""
# ----------------------------------------
